# Grasshopper definition 0.gh (Grasshopper 1.0.7)

# Texas HSR - Culvert 50+56SDFSDSFSSDFSDFSDFGEGT,A;SLDKFNA.S,DJNFAKLSDNF;LKASD;FLKANSD;FLKANSD;FLKNA;SDLKFNA;SLDKFN;ASLDKFN;ALSKDFN;ALSDKFN;ALKNSDF
panel = Panel("Texas HSR - Culvert")
list = ValueList({"English": "E", "Metric": "M"}, selected="English")
list_2 = ValueList({"HS20": 1, "H20": 2, "HS15": 3, "H15": 4, "E80": 5, "E72": 6, "HS25": 7, "NoLiveLoad": 9}, selected="HS20")
python = GhPythonScript(
    Run=Toggle(True),
    Project=panel,
    Spec=list,
    LiveLoad=list_2,
    NumberOfBoxes=Slider(2, range=0..10),
    ClearSpan=Slider(8, range=0..10),
    ClearHeight=Slider(8, range=0..10),
    EarthFill=Slider(5, range=0..10))  # -> out, a; inputs NumberOfBoxes: Int32
# ---------- python: Python ----------
__author__ = "karakusb"
__version__ = "2020.10.27"

import rhinoscriptsyntax as rs
import Rhino
out=[]
if Run:
    #PROB
    if len(Project)>74:
        rs.MessageBox("Project Name cannot exceeds 74 Characters",title="GH_CULV")
    else:
        prob="PROB "+Project+' '*(75-len(Project))
        print(len(prob))
    out.append(prob)




a=out
# ---------- end python ----------
panel_2 = Panel(python.a)
